% Simulink data dictionary canrx_0x1BF.sldd

R64 = Simulink.AliasType(BaseType="double")
R32 = Simulink.AliasType(BaseType="single")
SD = Simulink.AliasType(BaseType="int32")
SW = Simulink.AliasType(BaseType="int16")
SB = Simulink.AliasType(BaseType="int8")
UD = Simulink.AliasType(BaseType="uint32")
UW = Simulink.AliasType(BaseType="uint16")
UB = Simulink.AliasType(BaseType="uint8")
BOOL = Simulink.AliasType(BaseType="boolean")
SI = Simulink.NumericType(DataTypeMode="Fixed-point: unspecified scaling", SignednessBool=true, WordLength=32, FixedExponent=0)
UI = Simulink.NumericType(DataTypeMode="Fixed-point: unspecified scaling", SignednessBool=false, WordLength=32, FixedExponent=0)
CH = Simulink.NumericType(DataTypeMode="Fixed-point: unspecified scaling", SignednessBool=true, WordLength=8, FixedExponent=0)
SO = Simulink.NumericType(DataTypeMode="Fixed-point: unspecified scaling", SignednessBool=true, WordLength=64, FixedExponent=0)
UO = Simulink.NumericType(DataTypeMode="Fixed-point: unspecified scaling", SignednessBool=false, WordLength=64, FixedExponent=0)

canframeType = Simulink.Bus(DataScope="Exported", HeaderFile="canframe.h")
  canframe: fixdt(0,64,0)

SLDD_CFG = Simulink.ConfigSet(StartTime="0", StopTime="10", Solver="FixedStepDiscrete", ProdHWDeviceType="Infineon->TriCore", SystemTargetFile="ert.tlc", TargetLang="C")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
CanRx_can_gmlan_rx_trb_duty = Simulink.Signal(StorageClass="ExportedGlobal", DataType="UB", Min=0, Max=200)
CanRx_can_gmlan_rx_trb_power_off_enb_stat = Simulink.Signal(StorageClass="ExportedGlobal", DataType="UB", Min=0, Max=1)
CanRx_can_gmlan_rx_trb_ctrl_enb_stat = Simulink.Signal(StorageClass="ExportedGlobal", DataType="UB", Min=0, Max=1)
CanRx_can_gmlan_rx_vnt_act_pos = Simulink.Signal(StorageClass="ExportedGlobal", DataType="UW", Min=0, Max=1000)
CanRx_can_gmaln_rx_trb_err_msg = Simulink.Signal(StorageClass="ExportedGlobal", DataType="UW", Min=0, Max=65535)
inv_device_vnt = Simulink.Signal(StorageClass="ExportedGlobal", DataType="UB", Min=0, Max=1)
can_gmlan_rx_trb_duty = Simulink.Signal(StorageClass="ExportedGlobal", DataType="SB", Min=-100, Max=100)
can_gmlan_rx_trb_power_off_enb_stat = Simulink.Signal(StorageClass="ExportedGlobal", DataType="UB", Min=0, Max=1)
can_gmlan_rx_trb_ctrl_enb_stat = Simulink.Signal(StorageClass="ExportedGlobal", DataType="UB", Min=0, Max=1)
can_gmlan_rx_vnt_act_pos = Simulink.Signal(StorageClass="ExportedGlobal", DataType="fixdt(0, 16, 1/10, 0)", Min=0, Max=100)
can_gmaln_rx_trb_err_msg = Simulink.Signal(StorageClass="ExportedGlobal", DataType="UW", Min=0, Max=65535)